# Grasshopper definition 整理panel输入数据.gh (Grasshopper 1.0.8)

panel = Panel("""H          = 206.8
BTop       = 133.9
BBot       = 133.9
Tw         = 6.4
Rot        = 0

Setback    = 200

PlateT     = 12
Edge       = 15

HubR       = 90

AdapterW   = 50
AdapterH   = 100

MakeHub    = True""")
clean_tree = CleanTree(RemoveNulls=True, RemoveInvalid=True, RemoveEmpty=False, Tree=panel)
c_script = CSharpScript(Text=clean_tree)  # -> out, Values; inputs Text: String
# ---------- c_script: C# ----------
using System;
using System.Globalization;

using Grasshopper;
using Grasshopper.Kernel;
using Grasshopper.Kernel.Data;
using Grasshopper.Kernel.Types;

public class Script_Instance : GH_ScriptInstance
{
    private void RunScript(string Text, ref object Values)
    {
        GH_Structure<IGH_Goo> tree = new GH_Structure<IGH_Goo>();

        if (string.IsNullOrWhiteSpace(Text))
        {
            Values = tree;
            return;
        }

        // Support Windows / Unix line breaks
        string normalized = Text
            .Replace("\r\n", "\n")
            .Replace("\r", "\n");

        string[] lines = normalized.Split(
            new char[] { '\n' },
            StringSplitOptions.RemoveEmptyEntries
        );

        int branchIndex = 0;

        foreach (string rawLine in lines)
        {
            string line = rawLine.Trim();

            if (string.IsNullOrWhiteSpace(line))
                continue;

            int equalIndex = line.IndexOf('=');

            // Skip lines without =
            if (equalIndex < 0)
                continue;

            // Get everything after =
            string valueText = line
                .Substring(equalIndex + 1)
                .Trim()
                .Replace(" ", "");

            if (string.IsNullOrWhiteSpace(valueText))
                continue;

            GH_Path path = new GH_Path(branchIndex);

            // ------------------------------------
            // Boolean
            // ------------------------------------
            bool boolValue;

            if (bool.TryParse(valueText, out boolValue))
            {
                tree.Append(
                    new GH_Boolean(boolValue),
                    path
                );

                branchIndex++;
                continue;
            }

            // ------------------------------------
            // Number
            // ------------------------------------
            double numberValue;

            if (double.TryParse(
                valueText,
                NumberStyles.Any,
                CultureInfo.InvariantCulture,
                out numberValue))
            {
                tree.Append(
                    new GH_Number(numberValue),
                    path
                );

                branchIndex++;
                continue;
            }

            // ------------------------------------
            // Otherwise output string
            // ------------------------------------
            tree.Append(
                new GH_String(valueText),
                path
            );

            branchIndex++;
        }

        Values = tree;
    }
}
# ---------- end c_script ----------
division = Division(A=c_script.Values, B=1000)  # -> graft(Result)
explode_tree = ExplodeTree(Data=division)  # -> Branch0, Branch1, Branch2, Branch3, Branch4, Branch5, Branch6, Branch7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
