# Grasshopper definition 街区断线处理.gh (Grasshopper 1.0.8)
# plug-ins: Hare, Human, Wombat

curve = Curve([<curve referenced from the Rhino model> x257])
explode = Explode(Curve=curve, Recursive=True)  # -> flatten(Segments), Vertices
curve_2 = Curve([<curve referenced from the Rhino model> x107])
explode_2 = Explode(Curve=curve_2, Recursive=True)  # -> flatten(Segments), Vertices
remove_duplicate_curves = RemoveDuplicateCurves(Curves=explode.Segments, Count=2, Tolerance=0.001)
remove_duplicate_curves_2 = RemoveDuplicateCurves(Curves=explode_2.Segments, Count=2, Tolerance=0.001)
python_3_script = Python3Script(C=remove_duplicate_curves_2, tol=Slider(0.24, range=0..1))  # -> out, Blocks, AllBoundaries, Cleaned, SnapPts, UnresolvedPts, Report; inputs C: list of Curve, tol: Double, P: Plane, min_area: Double, project_to_plane: Boolean, explode_polycurves: Boolean
# ---------- python_3_script: Python ----------
# -*- coding: utf-8 -*-
import Rhino
import scriptcontext as sc
from Rhino.Geometry import (
    Curve, PolyCurve, PolylineCurve, LineCurve, NurbsCurve,
    Plane, Point3d, AreaMassProperties, Transform
)

# =========================
# helpers
# =========================

def ensure_list(x):
    if x is None:
        return []
    try:
        return [i for i in x if i is not None]
    except:
        return [x] if x is not None else []

def avg_point(pts):
    if not pts:
        return Point3d.Unset
    sx = sy = sz = 0.0
    for p in pts:
        sx += p.X
        sy += p.Y
        sz += p.Z
    n = float(len(pts))
    return Point3d(sx / n, sy / n, sz / n)

def curve_length(c):
    try:
        return c.GetLength()
    except:
        return 0.0

def project_curve(c, plane):
    try:
        pc = Curve.ProjectToPlane(c, plane)
        if pc: 
            return pc
    except:
        pass
    # fallback
    dup = c.DuplicateCurve()
    xform = Transform.PlanarProjection(plane)
    dup.Transform(xform)
    return dup

def explode_if_needed(curves, do_explode):
    out = []
    for c in curves:
        if not c or not c.IsValid:
            continue
        if do_explode and isinstance(c, PolyCurve):
            segs = c.DuplicateSegments()
            if segs and len(segs) > 0:
                out.extend([s for s in segs if s and s.IsValid])
            else:
                out.append(c.DuplicateCurve())
        else:
            out.append(c.DuplicateCurve())
    return out

def safe_set_start_end(curve, start_pt=None, end_pt=None):
    """
    优先直接 SetStartPoint / SetEndPoint；
    如果不支持，则对常见曲线类型做回退。
    """
    c = curve.DuplicateCurve()

    # 1) 先试 RhinoCommon 原生改端点
    ok_start = True
    ok_end = True
    if start_pt is not None:
        try:
            ok_start = c.SetStartPoint(start_pt)
        except:
            ok_start = False
    if end_pt is not None:
        try:
            ok_end = c.SetEndPoint(end_pt)
        except:
            ok_end = False

    if ok_start and ok_end and c and c.IsValid:
        return c

    # 2) LineCurve 回退
    if isinstance(curve, LineCurve):
        sp = start_pt if start_pt is not None else curve.PointAtStart
        ep = end_pt if end_pt is not None else curve.PointAtEnd
        lc = LineCurve(sp, ep)
        return lc if lc.IsValid else None

    # 3) PolylineCurve 回退
    if isinstance(curve, PolylineCurve):
        try:
            pl = curve.ToPolyline()
            pts = [pl[i] for i in range(pl.Count)]
            if len(pts) >= 2:
                if start_pt is not None:
                    pts[0] = start_pt
                if end_pt is not None:
                    pts[-1] = end_pt
                pc = PolylineCurve(pts)
                return pc if pc.IsValid else None
        except:
            pass

    # 4) Nurbs 回退
    try:
        nc = curve.ToNurbsCurve()
        if nc and nc.Points.Count >= 2:
            if start_pt is not None:
                cp0 = nc.Points[0]
                nc.Points.SetPoint(0, start_pt, cp0.Weight)
            if end_pt is not None:
                last = nc.Points.Count - 1
                cpn = nc.Points[last]
                nc.Points.SetPoint(last, end_pt, cpn.Weight)
            if nc.IsValid:
                return nc
    except:
        pass

    # 5) 最后返回原曲线副本
    return c if c and c.IsValid else None

def endpoint_records(curves):
    """
    返回每条曲线的首尾端点记录
    record = {
        'curve_index': i,
        'end': 0 or 1,   # 0=start, 1=end
        'pt': Point3d
    }
    """
    recs = []
    for i, c in enumerate(curves):
        if not c or not c.IsValid:
            continue
        recs.append({'curve_index': i, 'end': 0, 'pt': c.PointAtStart})
        recs.append({'curve_index': i, 'end': 1, 'pt': c.PointAtEnd})
    return recs

def cluster_points_complete_link(points, tol):
    """
    complete-link 风格聚类：
    同一个 cluster 内任意两点距离都 <= tol
    这样比单纯“连通分量聚类”更不容易把近邻街区误串起来。
    """
    remaining = set(range(len(points)))
    clusters = []

    while remaining:
        seed = min(remaining)
        cluster = [seed]
        remaining.remove(seed)

        changed = True
        while changed:
            changed = False
            # 候选：至少和 cluster 中某一点近
            candidates = []
            for i in list(remaining):
                if any(points[i].DistanceTo(points[j]) <= tol for j in cluster):
                    candidates.append(i)

            # 从最近的开始尝试加入；加入时要求对 cluster 全部成员都 <= tol
            candidates.sort(
                key=lambda i: min(points[i].DistanceTo(points[j]) for j in cluster)
            )

            for i in candidates:
                if i not in remaining:
                    continue
                if all(points[i].DistanceTo(points[j]) <= tol for j in cluster):
                    cluster.append(i)
                    remaining.remove(i)
                    changed = True

        clusters.append(cluster)

    return clusters

def build_snap_map(records, tol):
    pts = [r['pt'] for r in records]
    clusters = cluster_points_complete_link(pts, tol)

    snap_map = {}      # endpoint record idx -> snapped Point3d
    snap_pts = []      # 所有吸附点
    unresolved = []    # 单独端点

    for cl in clusters:
        cl_pts = [pts[i] for i in cl]
        if len(cl) == 1:
            unresolved.append(cl_pts[0])
            continue
        center = avg_point(cl_pts)
        snap_pts.append(center)
        for idx in cl:
            snap_map[idx] = center

    return snap_map, snap_pts, unresolved, clusters

def apply_snapping(curves, records, snap_map):
    """
    根据 snap_map 修改各曲线起终点
    """
    # 每条曲线可能有 start/end 两端要改
    edit_dict = {}  # curve_index -> {'start': pt or None, 'end': pt or None}
    for rec_idx, rec in enumerate(records):
        if rec_idx not in snap_map:
            continue
        ci = rec['curve_index']
        if ci not in edit_dict:
            edit_dict[ci] = {'start': None, 'end': None}
        if rec['end'] == 0:
            edit_dict[ci]['start'] = snap_map[rec_idx]
        else:
            edit_dict[ci]['end'] = snap_map[rec_idx]

    result = []
    for i, c in enumerate(curves):
        if i in edit_dict:
            sp = edit_dict[i]['start']
            ep = edit_dict[i]['end']
            new_c = safe_set_start_end(c, sp, ep)
            if new_c and new_c.IsValid:
                result.append(new_c)
            else:
                result.append(c.DuplicateCurve())
        else:
            result.append(c.DuplicateCurve())
    return result

def try_join(curves, tol):
    try:
        joined = Curve.JoinCurves(curves, tol)
        if joined and len(joined) > 0:
            return [c for c in joined if c and c.IsValid]
    except:
        pass
    return curves

def region_area(crv):
    try:
        amp = AreaMassProperties.Compute(crv)
        if amp:
            return abs(amp.Area)
    except:
        pass
    return 0.0

def extract_regions(curves, plane, tol, min_area):
    """
    用 RhinoCommon 的 BooleanRegions 提取封闭区
    返回：
      blocks         -> 每个 region 的外边界
      all_boundaries -> 所有边界（有洞时也会包含）
    """
    blocks = []
    all_boundaries = []

    try:
        cbr = Curve.CreateBooleanRegions(curves, plane, False, tol)
    except Exception as e:
        return [], [], "CreateBooleanRegions failed: {}".format(str(e))

    if cbr is None:
        return [], [], "CreateBooleanRegions returned None"

    try:
        region_count = cbr.RegionCount
    except:
        region_count = 0

    for i in range(region_count):
        try:
            bnds = cbr.RegionCurves(i)
        except:
            bnds = None

        if not bnds:
            continue

        valid_bnds = [b for b in bnds if b and b.IsValid]
        if not valid_bnds:
            continue

        # 文档说明：第一个边界是 outer boundary
        outer = valid_bnds[0]

        if outer and outer.IsClosed:
            a = region_area(outer)
            if a >= min_area:
                blocks.append(outer)
                all_boundaries.extend(valid_bnds)

    # 按面积从大到小排一下，输出更稳定
    blocks = sorted(blocks, key=lambda c: region_area(c), reverse=True)

    return blocks, all_boundaries, None

# =========================
# main
# =========================

# defaults
if tol is None:
    tol = sc.doc.ModelAbsoluteTolerance if sc.doc else 1.0

if P is None:
    P = Plane.WorldXY

if min_area is None:
    min_area = 0.0

if project_to_plane is None:
    project_to_plane = True

if explode_polycurves is None:
    explode_polycurves = False

input_curves = ensure_list(C)

# 1. 过滤无效 / 太短曲线
curves0 = []
short_count = 0
for c in input_curves:
    if not c or not c.IsValid:
        continue
    cc = c.DuplicateCurve()
    if project_to_plane:
        cc = project_curve(cc, P)
    if curve_length(cc) <= max(tol * 0.25, 1e-12):
        short_count += 1
        continue
    curves0.append(cc)

# 2. 是否打散 polycurve
curves1 = explode_if_needed(curves0, explode_polycurves)

# 3. 收集端点并做端点吸附
records = endpoint_records(curves1)
snap_map, snap_pts, unresolved_pts, clusters = build_snap_map(records, tol)
curves2 = apply_snapping(curves1, records, snap_map)

# 4. 先 join 一次，让明显能成链的段先拼起来
cleaned = try_join(curves2, tol)

# 5. 再跑一次 region 提取
blocks, all_boundaries, err = extract_regions(cleaned, P, tol, min_area)

# 6. report
report_lines = []
report_lines.append("Input curves: {}".format(len(input_curves)))
report_lines.append("Valid curves after clean: {}".format(len(curves1)))
report_lines.append("Removed very short curves: {}".format(short_count))
report_lines.append("Endpoint records: {}".format(len(records)))
report_lines.append("Endpoint clusters: {}".format(len(clusters)))
report_lines.append("Snapped endpoints: {}".format(len(snap_map)))
report_lines.append("Snap nodes: {}".format(len(snap_pts)))
report_lines.append("Unresolved endpoints: {}".format(len(unresolved_pts)))
report_lines.append("Cleaned curves after join: {}".format(len(cleaned)))
report_lines.append("Detected block regions: {}".format(len(blocks)))
if err:
    report_lines.append("Region extraction warning: {}".format(err))

Report = "\n".join(report_lines)
Blocks = blocks
AllBoundaries = all_boundaries
Cleaned = cleaned
SnapPts = snap_pts
UnresolvedPts = unresolved_pts
# ---------- end python_3_script ----------
join_curves_with_tolerance = JoinCurvesWithTolerance(Curves=remove_duplicate_curves, Tolerance=Slider(0.26, range=0..1), Option=0)
curve_3 = Curve(join_curves_with_tolerance)
curve_4 = Curve(python_3_script.Blocks)
curve_5 = Curve(python_3_script.Cleaned)
point = Point(python_3_script.UnresolvedPts)
boundary_surfaces = BoundarySurfaces(Edges=curve_3)  # disabled
panel = Panel(python_3_script.Report)
custom_preview_lineweights = CustomPreviewLineweights(
    Geometry=curve_3,
    Shader=ColourSwatch(SwatchColor=RGB(255, 255, 255)),
    Thickness=Slider(2.98, range=0..20),
    Absolute=False)
boundary_surfaces_2 = BoundarySurfaces(Edges=graft(curve_4))
panel_2 = Panel(curve_3)
custom_preview_lineweights_2 = CustomPreviewLineweights(
    Geometry=curve_4,
    Shader=ColourSwatch(SwatchColor=RGB(255, 255, 255)),
    Thickness=Slider(3.31, range=0..20),
    Absolute=False)
custom_preview = CustomPreview(Geometry=boundary_surfaces_2, Material=ColourSwatch(SwatchColor=RGB(38, 62, 102)))
panel_3 = Panel(curve_4)
